# Grasshopper definition RoboJenga 003.gh (Grasshopper 1.0.7)
# plug-ins: Robots

basecalib_old = Panel("""911.91,679.39,199.86
510.58,689.92,198.87
473.66,-703.30,204.07""")
speeds = Panel("""100,pi*1.0
500,pi*1.0
1000,pi*2.0""")
basecalib = Panel("""901.8,669.9,193.0
500.9,678.2,192.1
469.7,-714.1,200""")
tile_size = Panel("180,60+0,45")
tile_count = Panel("4*3")
gripping_wait = Panel("0.4")
pick_offset = Panel("45+20")
solenoid_do = Panel("0")
block_name = Panel("Tile")

# ---- group: tower file
path = FilePath("C:\Users\vicen\Desktop\Workshop 2\StackingRobot\Assets\tower.xml")  # disabled

# ---- group: tower locations
pt = Point([<point referenced from the Rhino model> x2])

# ----
zones = Panel("""0
2
20""")
list = ValueList({"AA-KR60", "AA-KR30", "AA-KR60_KR30", "AARCH IRB120", "AARCH IRB6620", "Bartlett-IRB120", "Bartlett-IRB1600", "Bartlett-KR6", "Bartlett-KR60", "Bartlett-UR10"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}, selected="Bartlett-IRB1600")
c_script = CSharpScript(F=path)  # -> out, A; inputs F: String; disabled
# ---------- c_script: C# ----------
    var assembly = Assembly.Export(F);
    A = assembly.Tiles.Select(t => t.ToPlane());
# ---------- c_script: C# additional code ----------
  public class Assembly
  {
    public List<Orient> Tiles { get; set; }

    public static Assembly Export(string fileName)
    {
      Assembly assembly = null;
      var serializer = new System.Xml.Serialization.XmlSerializer(typeof(Assembly));
      using (var reader = XmlReader.Create(fileName))
      {
        assembly = serializer.Deserialize(reader) as Assembly;
      }

      return assembly;
    }
  }

  public struct Orient
  {
    public Vector3 Center;
    public QuaternionExport Rotation;

    public Plane ToPlane()
    {
      var q = Rotation.ToQuaternion();
      Plane plane;
      q.GetRotation(out plane);
      plane.Origin = Center.ToPoint3d();

      return plane;
    }
  }

  public struct Vector3
  {
    public float x, y, z;

    public Point3d ToPoint3d()
    {
      return new Point3d(x, z, y) * 1000;
    }
  }

  [System.Xml.Serialization.XmlType(TypeName = "Quaternion")]
  public struct QuaternionExport
  {
    public float x, y, z, w;

    public Quaternion ToQuaternion()
    {
      return new Quaternion(-w, x, z, y);
    }
  }
# ---------- end c_script ----------
num = Number(gripping_wait)

# ---- group: tool
stroke_per_jaw = Panel("8")
pt_2 = Point(<point referenced from the Rhino model>)

# ----
speed = SpeedParameter(speeds)
zone = ZoneParameter(zones)

# ---- group: tool / static tool
brep = Brep([<brep referenced from the Rhino model> x2])

# ---- group: tool / dynamic tool
brep_2 = Brep([<brep referenced from the Rhino model> x4])

# ----
c_script_2 = CSharpScript(S=tile_size, N=tile_count)  # -> out, A; inputs S: Vector3d, N: Int32
# ---------- c_script_2: C# ----------
    _tiles = new List<Plane>();
    _tileSize = S;

    MakeTower(N);

    A = _tiles;
# ---------- c_script_2: C# additional code ----------
  List<Plane> _tiles;
  Vector3d _tileSize;

  void MakeTower(int count)
  {
    for (int i = 0; i < count; i++)
      AddTile();
  }

  void AddTile()
  {
    int count = _tiles.Count;
    int layer = count / 3;
    int horiz = count % 3;
    bool isEven = layer % 2 == 0;

    var plane = Plane.WorldXY;
    plane.Origin = new Point3d(0, (horiz - 1) * _tileSize.Y, (layer + 1) * _tileSize.Z);
    double rotation = isEven ? 0 : -Math.PI / 2;
    plane.Rotate(rotation, plane.Normal, Point3d.Origin);
    _tiles.Add(plane);
  }
# ---------- end c_script_2 ----------
c_script_3 = CSharpScript(T=block_name)  # -> out, G, Pi, Pl; inputs T: String
# ---------- c_script_3: C# ----------
    var definition = RhinoDocument.InstanceDefinitions.Find(T, true);
    var instances = definition.GetReferences(1);


    int pickingIndex = RhinoDocument.Layers.Find("Picking", true);
    int placingIndex = RhinoDocument.Layers.Find("Placing", true);

    var pickingInstances = instances.Where(x => x.Attributes.LayerIndex == pickingIndex);
    var placingInstances = instances.Where(x => x.Attributes.LayerIndex == placingIndex);


    G = GetDefinitionGeometry(definition);
    Pi = pickingInstances.Select(i => GetInstanceFrame(i));
    Pl = placingInstances.Select(i => GetInstanceFrame(i));
# ---------- c_script_3: C# additional code ----------
  IEnumerable<GeometryBase> GetDefinitionGeometry(InstanceDefinition definition)
  {
    int geometryIndex = RhinoDocument.Layers.Find("Geometry", true);

    return definition.GetObjects()
      .Where(x => x.Attributes.LayerIndex == geometryIndex)
      .Select(x => x.Geometry);
  }

  Plane GetInstanceFrame(InstanceObject instance)
  {
    var plane = Plane.WorldXY;
    plane.Transform(instance.InstanceXform);
    return plane;
  }
# ---------- end c_script_3 ----------
setdo = SetDO(DO=solenoid_do, Value="true")
wait = Wait(Time=num)
setdo_2 = SetDO(DO=solenoid_do, Value="false")
pt_3 = Point(basecalib)
merge = Merge(Data1=setdo, Data2=wait)
merge_2 = Merge(Data1=setdo_2, Data2=wait)
xy = XYPlane(Origin="0,0,0")
entwine = Entwine(Branch00=c_script_2.A, Branch01=reverse(c_script_2.A), FlattenInputs=True)
pt_4 = Point(pt_3)
load_robot = LoadRobotSystem(Name=list, Base=xy)
item = ListItem(List=pt_4, Index=0, Wrap=True)  # -> Item, Item1, Item2
groupcmd = GroupCommand(Commands=merge)
groupcmd_2 = GroupCommand(Commands=merge_2)
jagged = SettingsSpeed()
move = Move(Geometry=entwine, Motion=graft(pt))  # -> Geometry, Transform
merge_3 = Merge(Data1=groupcmd, Data2=groupcmd_2)
pl_3pt = Plane3Pt(PointA=item.Item1, PointB=item.Item2, PointC=item.Item)  # -> flatten(Plane)
pdecon = Deconstruct(Point=move.Geometry)  # -> XComponent, YComponent, ZComponent
orient = Orient(Geometry="0,0,0", Source=pl_3pt, Target=PlaneXY(0, 0, 0))  # -> Geometry, Transform
sort = SortList(Keys=pdecon.ZComponent, ValuesA=move.Geometry)  # -> Keys, ValuesA
c_script_4 = CSharpScript(P=sort.ValuesA, R=orient.Geometry)  # -> out, A; inputs P: Plane, R: Point3d
# ---------- c_script_4: C# ----------
    Plane plane = P;

    if (P.OriginX < R.X)
    {
      double angle = Vector3d.VectorAngle(P.XAxis, new Vector3d(1, 1, 0));
      if(angle > Math.PI / 2) plane.Rotate(Math.PI, plane.Normal);
    }
    else
    {
      double angle = Vector3d.VectorAngle(P.XAxis, new Vector3d(-1, 1, 0));
      if(angle < Math.PI / 2) plane.Rotate(Math.PI, plane.Normal);
    }

    A = plane;
# ---------- end c_script_4 ----------
frame = FrameParameter(pl_3pt)
bang = ExplodeTree(Data=c_script_4.A)  # -> Branch0, Branch1
short = ShortestList(ListA=bang.Branch0, ListB=bang.Branch1, TrimMode=2)  # -> ListA, ListB
entwine_2 = Entwine(Branch00=short.ListA, Branch01=short.ListB, FlattenInputs=True)
bang_2 = ExplodeTree(Data=entwine_2)  # -> reverse(Branch0), Branch1
panel = Panel("""0
-1""")

# ---- group: run animation
folder = Panel("C:\Users\vicen\Desktop\anim03")  # disabled
image_size = Panel("1920*2 to 1080*2")  # disabled
toggle = BooleanToggle(False)  # disabled
total_frames = Panel("2400")  # disabled
list_2 = ValueList({"Render": 0, "Capture": 1}, selected="Capture")  # disabled
start_frame = Panel("0")  # disabled
c_script_5 = CSharpScript(R=toggle, M=list_2, Z=image_size, S=start_frame, C=total_frames, F=folder)  # -> out, i, t; inputs R: Boolean, M: Int32, S: Int32, C: Int32, F: String; disabled
# ---------- c_script_5: C# ----------
    if(!R)
    {
      i = _count = S;
      t = Parameter(C);
    }
    else
    {
      switch(M)
      {
        case 0: { Render(F);break;}
        case 1: { Capture(F, new Size((int) Z.T0, (int) Z.T1));break;}
      }

      i = _count;
      t = Parameter(C);
      _count++;
      if(_count < C) Component.ExpireSolution(true);
    }
# ---------- c_script_5: C# additional code ----------
  int _count;


  double Parameter(int max)
  {
    return (double) _count / (double) (max - 1);
  }

  void Render(string path)
  {
    Rhino.RhinoApp.RunScript("_-Render", false);
    RhinoApp.Wait();
    string save = String.Format("_-SaveRenderWindowAs \"{0}\\frame{1:0000}.jpg\"", path, _count);
    Rhino.RhinoApp.RunScript(save, false);
    Rhino.RhinoApp.RunScript("_-CloseRenderWindow", false);
  }

  void Capture(string path, Size size)
  {
    RhinoDocument.Views.ActiveView.Redraw();
    string file = String.Format("{0}\\frame{1:0000}.png", path, _count);
    var bitmap = RhinoDocument.Views.ActiveView.CaptureToBitmap(size);
    bitmap.Save(file, System.Drawing.Imaging.ImageFormat.Png);
  }
# ---------- end c_script_5 ----------

# ----
program_name = Panel("Jenga")
jagged_2 = SettingsSpeed()
mesh = MeshBrep(Brep=c_script_3.G, Settings=jagged_2)
# * speed limit reached *
panel_2 = Panel("Configuration changed *")

# ---- group: baked meshes
id = Guid([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])

# ---- group: create tool
partition = PartitionList(List=brep_2, Size=2)
sunion = SolidUnion(Breps=partition)  # -> flatten(Result)
Y = UnitY(Factor=stroke_per_jaw)
panel_3 = Panel("""1
-1""")
mesh_2 = MeshBrep(Brep=sunion, Settings=jagged)
multiplication = Multiplication(A=Y, B=panel_3)
mesh_3 = MeshBrep(Brep=brep, Settings=jagged)
move_2 = Move(Geometry=mesh_2, Motion=multiplication)  # -> Geometry, Transform
pl = ConstructPlane(Origin=pt_2, XAxis="0,-1,0", YAxis="-1,0,0")
panel_4 = Panel("""GripperUnloaded
GripperLoaded""")
tool_weight = Panel("""1.35+2.0+0.0
1.35+2.0+0.25""")

# ----
entwine_3 = Entwine(Branch00=mesh_2, Branch01=move_2.Geometry, FlattenInputs=True)

# ---- group: create tool (continued)
ins = InsertItems(List=entwine_3, Item=mesh_3, Indices="0", Wrap=True)
mjoin = MeshJoin(Meshes=ins)  # -> flatten(Mesh)
tool = CreateTool(Name=panel_4, TCP=pl, Weight=tool_weight, Mesh=mjoin)  # -> Tool, TCP

# ----
merge_4 = Merge(Data1=tool.Tool, Data2=speed, Data3=zone, Data4=merge_3, Data5=frame)

# ---- group: home position
panel_5 = Panel("0,pi/2,-pi*0.1,0,pi*0.1,0")
item_2 = ListItem(List=tool.Tool, Index=0, Wrap=True)
target = CreateTarget(Joints=panel_5, Tool=item_2, Speed="250", Zone="0", IsCartesian=False)

# ----
K = Kinematics(RobotSystem=load_robot, Target=target, DisplayGeometry=True)  # -> Meshes, Joints, Planes, Errors
item_3 = ListItem(List=K.Planes, Index=-1, Wrap=True)
move_3 = Move(Geometry=item_3, Motion="0,0,-200")  # -> Geometry, Transform
c_script_6 = CSharpScript(
    Pi=bang_2.Branch0,
    Pl=bang_2.Branch1,
    A=merge_4,
    O=pick_offset,
    Cp=move_3.Geometry,
    Reference="C:\Users\vicen\AppData\Roaming\Grasshopper\Libraries\Robots.dll")  # -> out, T; inputs Pi: list of Plane, Pl: list of Plane, A: list, O: Double, Cp: Point3d
# ---------- c_script_6: C# usings ----------
using System.IO;
using System.Linq;
using System.Data;
using System.Drawing;
using System.Reflection;
using System.Windows.Forms;
using System.Xml;
using System.Xml.Linq;
using System.Runtime.InteropServices;

using Rhino.DocObjects;
using Rhino.Collections;
using GH_IO;
using GH_IO.Serialization;
using Robots;
using Robots.Commands;
# ---------- c_script_6: C# ----------
    _tools = A.OfType<Tool>().ToList();
    _speeds = A.OfType<Speed>().ToList();
    _zones = A.OfType<Zone>().ToList();
    _commands = A.OfType<Command>().ToList();
    _frame = A.OfType<Frame>().First();
    _offset = O;

    var targets = new List<CartesianTarget>();

    for(int i = 0;i < Pi.Count;i++)
    {
      Point3d currentPos = targets.Count > 0 ? targets[targets.Count - 1].Plane.Origin : Cp;
      targets.AddRange(GetPickAndPlaceTargets(Pi[i], Pl[i], currentPos));
    }

    T = targets;
# ---------- c_script_6: C# additional code ----------
  List<Tool> _tools;
  List<Speed> _speeds;
  List<Zone> _zones;
  List<Command> _commands;
  Frame _frame;

  double _offset;

  List<CartesianTarget> GetPickAndPlaceTargets(Plane pick, Plane place, Point3d currentPos)
  {
    var targets = new List<CartesianTarget>();

    var conf = Target.RobotConfigurations.Wrist;

    // pick avoid diagonal movements
    if(currentPos.Z > pick.OriginZ + _offset)
    {
      var plane = Plane.WorldXY;
      plane.Origin = new Point3d(pick.OriginX, pick.OriginY, currentPos.Z);
      targets.Add(new CartesianTarget(plane, null, Target.Motions.Linear, _tools[0], _speeds[2], _zones[2], null, _frame, null));
    }
    else
    {
      var plane = Plane.WorldXY;
      plane.Origin = new Point3d(currentPos.X, currentPos.Y, pick.OriginZ + _offset);
      targets.Add(new CartesianTarget(plane, null, Target.Motions.Linear, _tools[0], _speeds[2], _zones[2], null, _frame, null));
    }

    // pick offset
    {
      var plane = Plane.WorldXY;
      plane.Origin = pick.Origin + _offset * Vector3d.ZAxis;
      targets.Add(new CartesianTarget(plane, conf, Target.Motions.Linear, _tools[0], _speeds[2], _zones[2], null, _frame, null));
    }

    // pick offset alignment
    {
      var plane = pick;
      plane.Origin = pick.Origin + _offset * Vector3d.ZAxis;
      targets.Add(new CartesianTarget(plane, null, Target.Motions.Linear, _tools[0], _speeds[2], _zones[2], null, _frame, null));
    }

    // pick target
    {
      targets.Add(new CartesianTarget(pick, null, Target.Motions.Linear, _tools[0], _speeds[0], _zones[0], _commands[0], _frame, null));
    }

    // pick offset alignment loaded
    {
      var plane = pick;
      plane.Origin = pick.Origin + _offset * Vector3d.ZAxis;
      targets.Add(new CartesianTarget(plane, null, Target.Motions.Linear, _tools[1], _speeds[1], _zones[2], null, _frame, null));
    }

    // pick offset loaded
    {
      var plane = Plane.WorldXY;
      plane.Origin = pick.Origin + _offset * Vector3d.ZAxis;
      targets.Add(new CartesianTarget(plane, null, Target.Motions.Linear, _tools[1], _speeds[2], _zones[2], null, _frame, null));
    }

    // place avoid diagonal movements
    if(pick.OriginZ > place.OriginZ)
    {
      var plane = Plane.WorldXY;
      plane.Origin = new Point3d(place.OriginX, place.OriginY, pick.OriginZ + _offset);
      targets.Add(new CartesianTarget(plane, null, Target.Motions.Linear, _tools[1], _speeds[2], _zones[2], null, _frame, null));
    }
    else
    {
      var plane = Plane.WorldXY;
      plane.Origin = new Point3d(pick.OriginX, pick.OriginY, place.OriginZ + _offset);
      targets.Add(new CartesianTarget(plane, null, Target.Motions.Linear, _tools[1], _speeds[2], _zones[2], null, _frame, null));
    }

    // place offset
    {
      var plane = Plane.WorldXY;
      plane.Origin = place.Origin + _offset * Vector3d.ZAxis;
      targets.Add(new CartesianTarget(plane, conf, Target.Motions.Joint, _tools[1], _speeds[2], _zones[2], null, _frame, null));
    }

    // place offset aligned
    {
      var plane = place;
      plane.Origin = place.Origin + _offset * Vector3d.ZAxis;
      targets.Add(new CartesianTarget(plane, null, Target.Motions.Linear, _tools[1], _speeds[2], _zones[2], null, _frame, null));
    }

    // place target
    {
      targets.Add(new CartesianTarget(place, null, Target.Motions.Linear, _tools[1], _speeds[0], _zones[0], _commands[1], _frame, null));
    }

    // place offset aligned unloaded
    {
      var plane = place;
      plane.Origin = place.Origin + _offset * Vector3d.ZAxis;
      targets.Add(new CartesianTarget(plane, null, Target.Motions.Linear, _tools[0], _speeds[1], _zones[2], null, _frame, null));
    }

    // pick offset unloaded
    {
      var plane = Plane.WorldXY;
      plane.Origin = place.Origin + _offset * Vector3d.ZAxis;
      targets.Add(new CartesianTarget(plane, null, Target.Motions.Linear, _tools[0], _speeds[2], _zones[2], null, _frame, null));
    }


    return targets;
  }
# ---------- end c_script_6 ----------
ins_2 = InsertItems(List=c_script_6.T, Item=target, Indices=panel, Wrap=True)
program = CreateProgram(Name=program_name, RobotSystem=load_robot, Targets1=ins_2, StepSize="1")  # -> Program, Code, Duration, Warnings, Errors
remote = RemoteConnection(Program=program.Program, Upload=Button(), Play=False, Pause=False)
sim = ProgramSimulation(Program=program.Program, Time=Slider(0.788832, range=0..1), Normalized=True)  # -> RobotMeshes, JointRotations, Plane, Index, Time, Program, Errors
panel_6 = Panel(remote)
c_script_7 = CSharpScript(P=sim.Program, W=num, Bp=entwine_2, Reference="C:\Users\vicen\AppData\Roaming\Grasshopper\Libraries\Robots.dll")  # -> out, T, G, Br; inputs W: Double, Bp: tree of Plane
# ---------- c_script_7: C# ----------
    if(P as Program != program)
    {
      program = P as Program;
      Setup(Bp.Branch(0).Count);
    }

    double currentTime = program.CurrentSimulationTime;
    var currentTarget = program.CurrentSimulationTarget;
    int i = Math.Min(currentTarget.Index + 1, program.Targets.Count - 1);
    var nextTarget = program.Targets[i];
    Plane plane = currentTarget.ProgramTargets[group].WorldPlane;
    var mesh = currentTarget.ProgramTargets[group].Target.Tool.Mesh.DuplicateMesh();
    mesh.Vertices.Clear();
    var vertices = currentTarget.ProgramTargets[group].Target.Tool.Mesh.Vertices.Zip(nextTarget.ProgramTargets[group].Target.Tool.Mesh.Vertices, (x,y) => Lerp(x, y, currentTime, currentTarget.TotalTime - W, currentTarget.TotalTime));
    mesh.Vertices.AddVertices(vertices);
    mesh.Transform(Transform.PlaneToPlane(currentTarget.ProgramTargets[group].Target.Tool.Tcp, plane));
    T = mesh;

    if (currentTarget.ProgramTargets[group].Target.Tool.Name == "GripperLoaded")
      G = plane;

    var currentBlocks = new DataTree<Plane>();
    currentBlocks.AddRange(Bp.Branch(0).GetRange(0, blocksRemaining[currentTarget.Index]), new GH_Path(0));
    currentBlocks.AddRange(Bp.Branch(1).GetRange(0, blocksPlaced[currentTarget.Index]), new GH_Path(1));
    Br = currentBlocks;
# ---------- c_script_7: C# additional code ----------
  Program program;
  int group = 0;
  List<int> blocksRemaining;
  List<int> blocksPlaced;

  void Setup(int blockCount)
  {
    blocksRemaining = new List<int>();
    blocksPlaced = new List<int>();

    int remaining = blockCount;
    int placed = 0;

    foreach(var cellTarget in program.Targets)
    {
      var target = cellTarget.ProgramTargets[group];
      if (target.Index != 0)
      {
        //    var doCommand = program.Targets[target.Index - 1].ProgramTargets[group].Commands.OfType<Robots.Commands.SetDO>().FirstOrDefault();
        var command = program.Targets[target.Index - 1].ProgramTargets[group].Commands.OfType<Robots.Commands.SetDO>().FirstOrDefault();

        if (command != null)
        {
          Robots.Commands.SetDO doCommand = command as Robots.Commands.SetDO;
              if (doCommand.Value) remaining -= 1;
              if (!doCommand.Value) placed += 1;
        }
      }
      blocksRemaining.Add(remaining);
      blocksPlaced.Add(placed);
    }
  }



  Point3d Lerp(Point3d a, Point3d b, double val, double min, double max)
  {
    double t = (val - min) / (max - min);
    if (double.IsNaN(t)) t = 0;
    t = Rhino.RhinoMath.Clamp(t, 0, 1);
    var lerp = a * (1 - t) + b * t;
    return lerp;
  }
# ---------- end c_script_7 ----------
orient_2 = Orient(Geometry=c_script_7.Br, Source=PlaneXY(0, 0, 0), Target=pl_3pt)  # -> Geometry, Transform
replace = ReplaceItems(List=sim.RobotMeshes, Item=c_script_7.T, Indices=-1, Wrap=True)

# ---- group: collision detection between gripper and forearm
panel_7 = Panel("100")  # disabled
panel_8 = Panel("pi/8")  # disabled
collisions = CheckCollisions(Program=program.Program, FirstSet=7, SecondSet=4, EnvironmentPlane=-1, LinearStepSize=panel_7, AngularStepSize=panel_8)  # -> CollisionFound, TargetIndex, CollidedMeshes; disabled
panel_9 = Panel(collisions.TargetIndex)  # disabled
panel_10 = Panel(collisions.CollisionFound)  # disabled

# ----
orient_3 = Orient(Geometry=c_script_7.G, Source=pl_3pt, Target=PlaneXY(0, 0, 0))  # -> Geometry, Transform
txt = Text(program.Warnings)
orient_4 = Orient(Geometry=mesh, Source=PlaneXY(0, 0, 0), Target=c_script_7.Br)  # -> Geometry, Transform
orient_5 = Orient(Geometry=mesh, Source=PlaneXY(0, 0, 0), Target=orient_3.Geometry)  # -> Geometry, Transform
orient_6 = Orient(Geometry=replace, Source=pl_3pt, Target=PlaneXY(0, 0, 0))  # -> Geometry, Transform
tmatch = MatchText(Text=txt, Pattern=panel_2, Case=True)
merge_5 = Merge(Data1=orient_5.Geometry, Data2=orient_4.Geometry)
cull = CullPattern(List=txt, CullPattern=tmatch)
split = SplitList(List=orient_6.Geometry, Index="7")  # -> ListA, ListB

# ---- group: display geometry
preview = CustomPreview(Geometry=split.ListA, Shader=ColourSwatch(SwatchColor=RGB(212, 85, 0)))  # disabled
preview_2 = CustomPreview(Geometry=split.ListB, Shader=ColourSwatch(SwatchColor=RGB(113, 114, 120)))  # disabled
preview_3 = CustomPreview(Geometry=merge_5, Shader=ColourSwatch(SwatchColor=RGB(224, 203, 175)))  # disabled

# ----
mjoin_2 = MeshJoin(Meshes=flatten(merge_5))
mjoin_3 = MeshJoin(Meshes=split.ListA)
mjoin_4 = MeshJoin(Meshes=split.ListB)
merge_6 = Merge(Data1=flatten(mjoin_3), Data2=flatten(mjoin_4), Data3=flatten(mjoin_2))

# ---- group: meshes to animate
mesh_4 = Mesh(merge_6)

# ----
c_script_8 = CSharpScript(G=id, M=mesh_4)  # -> out; inputs G: list of Guid, M: list of Mesh
# ---------- c_script_8: C# usings ----------
using System.IO;
using System.Linq;
using System.Data;
using System.Drawing;
using System.Reflection;
using System.Windows.Forms;
using System.Xml;
using System.Xml.Linq;
using System.Runtime.InteropServices;

using Rhino.DocObjects;
using Rhino.Collections;
using GH_IO;
using GH_IO.Serialization;
# ---------- c_script_8: C# ----------
    for(int i = 0;i < G.Count;i++)
    {
      RhinoDocument.Objects.Replace(G[i], M[i]);
    }
# ---------- end c_script_8 ----------

# ---- group: calibration program
pt_5 = Point(<point referenced from the Rhino model>)
brep_3 = Brep(<brep referenced from the Rhino model>)
pt_6 = Point(graft(pt_4))
mesh_5 = MeshBrep(
    Brep=brep_3,
    Settings={GridMaxCount=0, GridMinCount=16, JaggedSeams=False, MaxEdgeLength=0, MinEdgeLength=0.0001, MinTolerance=0, Refine=True, RefineAngle=0, RelativeTolerance=0.65, SimplePlanes=True, Tolerance=0})
xy_2 = XYPlane(Origin=pt_5)
pl_2 = ConstructPlane(Origin=pt_6, XAxis="-1,0,0", YAxis=Vector(0, 1, 0))
tool_2 = CreateTool(Name="CalbSpike", TCP=xy_2, Weight="0.1", Mesh=mesh_5)  # -> Tool, TCP
pl_offset = PlaneOffset(BasePlane=pl_2, Offset="-100")
txt_2 = Text(panel_5)
target_2 = CreateTarget(Joints=txt_2, Tool=tool_2.Tool, Speed="250", Zone="0", IsCartesian=False)
panel_11 = Panel("""250
100
250""")
panel_12 = Panel("""Joint
Linear
Linear""")
speed_2 = SpeedParameter(panel_11)
panel_13 = Panel("""0
-1""")
program_name_2 = Panel("JengaCalib")

# ----
pl_offset_2 = PlaneOffset(BasePlane=pl_2, Offset="-5")

# ---- group: calibration program (continued)
merge_7 = Merge(Data1=pl_offset, Data2=pl_offset_2, Data3=pl_offset)
target_3 = CreateTarget(Target=target_2, Plane=merge_7, Motion=panel_12, Speed=speed_2, IsCartesian=True)  # -> flatten(Target)
ins_3 = InsertItems(List=target_3, Item=target_2, Indices=panel_13, Wrap=True)
program_2 = CreateProgram(Name=program_name_2, RobotSystem=load_robot, Targets1=ins_3, StepSize="1")  # -> Program, Code, Duration, Warnings, Errors
panel_14 = Panel(program_2.Warnings)
sim_2 = ProgramSimulation(Program=program_2.Program, Time=Slider(0.25693327, range=0..1), Normalized=True)  # -> RobotMeshes, JointRotations, Plane, Index, Time, Program, Errors

# ----
remote_2 = RemoteConnection(Program=program_2.Program, Upload=Button(), Play=False, Pause=False)
panel_15 = Panel(remote_2)
orient_7 = Orient(Geometry=sim_2.RobotMeshes, Source=pl_3pt, Target=PlaneXY(0, 0, 0))  # -> Geometry, Transform

# ---- group: calibration program / display geometry
mesh_6 = Mesh(orient_7.Geometry)
