# Grasshopper definition TowerData_WALDO.gh (Grasshopper 1.0.7)

geo = Geometry([<brep referenced from the Rhino model> x10])
geo_2 = Geometry([<brep referenced from the Rhino model> x15])
geo_3 = Geometry([<brep referenced from the Rhino model> x6])
area = Area(Geometry=geo)  # -> Area, Centroid
area_2 = Area(Geometry=geo_2)  # -> Area, Centroid
area_3 = Area(Geometry=geo_3)  # -> Area, Centroid
pdecon = Deconstruct(Point=area.Centroid)  # -> XComponent, YComponent, ZComponent
bbox = BoundingBox(Content=geo, Plane=PlaneXY(0, 0, 0))  # -> Box, Box_2
bbox_2 = BoundingBox(Content=geo_2, Plane=PlaneXY(0, 0, 0))  # -> Box, Box_2
bbox_3 = BoundingBox(Content=geo_3, Plane=PlaneXY(0, 0, 0))  # -> Box, Box_2
sort = SortList(Keys=pdecon.ZComponent, ValuesA=area.Centroid)  # -> Keys, ValuesA
pdecon_2 = Deconstruct(Point=area_2.Centroid)  # -> XComponent, YComponent, ZComponent
sort_2 = SortList(Keys=pdecon.ZComponent, ValuesA=bbox.Box)  # -> Keys, ValuesA
pdecon_3 = Deconstruct(Point=area_3.Centroid)  # -> XComponent, YComponent, ZComponent
sort_3 = SortList(Keys=pdecon_2.ZComponent, ValuesA=area_2.Centroid)  # -> Keys, ValuesA
sort_4 = SortList(Keys=pdecon_3.ZComponent, ValuesA=area_3.Centroid)  # -> Keys, ValuesA
sort_5 = SortList(Keys=pdecon_2.ZComponent, ValuesA=bbox_2.Box)  # -> Keys, ValuesA
sort_6 = SortList(Keys=pdecon_3.ZComponent, ValuesA=bbox_3.Box)  # -> Keys, ValuesA
boxprop = BoxProperties(Box=sort_2.ValuesA)  # -> Center, Diagonal, Area, Volume, Degeneracy
boxprop_2 = BoxProperties(Box=sort_6.ValuesA)  # -> Center, Diagonal, Area, Volume, Degeneracy
boxprop_3 = BoxProperties(Box=sort_5.ValuesA)  # -> Center, Diagonal, Area, Volume, Degeneracy
rev = ReverseList(List=boxprop.Diagonal)
rev_2 = ReverseList(List=sort_4.ValuesA)
rev_3 = ReverseList(List=boxprop_2.Diagonal)
rev_4 = ReverseList(List=sort.ValuesA)
rev_5 = ReverseList(List=sort_3.ValuesA)
rev_6 = ReverseList(List=boxprop_3.Diagonal)
python = GhPythonScript(dataIn=rev_2, dia=rev_3)  # -> out; inputs dataIn: list of Point3d, dia: list of Vector3d
# ---------- python: Python ----------
dataIn #centroid data input

out = []
for c, v in zip(dataIn, dia):
    xl = c.X/100
    yl = c.Y/100
    zl = (c.Z + 4.5/2)/100
    if v.X > v.Y:
        ang = "0"
    else: ang = "90"
    
    strLine = str(xl) + "," + str(yl) + "," + str(zl) +"," + ang + ";"
    out.append(strLine)
# ---------- end python ----------
python_2 = GhPythonScript(dataIn=rev_5, dia=rev_6)  # -> out; inputs dataIn: list of Point3d, dia: list of Vector3d; same code as python
python_3 = GhPythonScript(dataIn=rev_4, dia=rev)  # -> out; inputs dataIn: list of Point3d, dia: list of Vector3d; same code as python
panel = Panel(python_2)
panel_2 = Panel(python)
panel_3 = Panel(python_3)
